# Grasshopper definition part1.gh (Grasshopper 1.0.7)
# plug-ins: Weaverbird, Kangaroo2 Components, Pufferfish, EleFront, Bifocals

# ----
# reference line
inner_diameter = Slider(1000, range=0..10000)
outer_diameter = Slider(3000, range=0..10000)
normal_direction_frame_count = Slider(50, range=0..100)
outer_frequency = Slider(3, range=0..10)
inner_frequency = Slider(4, range=0..10)
merge = Merge(Data1=outer_diameter, Data2=inner_diameter)
cir = Circle(Plane=PlaneXY(0, 0, 0), Radius=merge)
divide = DivideCurve(Curve=cir, Count=normal_direction_frame_count, Kinks=False)  # -> Points, Tangents, Parameters
merge_2 = Merge(Data1=outer_frequency, Data2=inner_frequency)
multiplication = Multiplication(A=Slider(360, range=0..1000), B=merge_2)
lng = ListLength(List=divide.Points)
dom = ConstructDomain(DomainStart=Slider(0, range=0..100), DomainEnd=multiplication)
range = Range(Domain=graft(dom), Steps=lng)
cull_i = CullIndex(List=range, Indices=Slider(-1, range=-1..0), Wrap=True)
outer_amplitude = Slider(500, range=500..1000)
inner_amplitude = Slider(100, range=0..1000)
rad = Radians(Degrees=cull_i)
sin = Sine(Value=rad)
merge_3 = Merge(Data1=outer_amplitude, Data2=inner_amplitude)
Z = UnitZ(Factor=sin)
multiplication_2 = Multiplication(A=Z, B=graft(merge_3))
move = Move(Geometry=divide.Points, Motion=multiplication_2)  # -> Geometry, Transform
bang = ExplodeTree(Data=move.Geometry)  # -> _0000, _0100
ln = Line(StartPoint=bang._0000, EndPoint=bang._0100)

# ----
# TriangleDivision
count_of_panels = Slider(5, range=0..10)
divide_2 = DivideCurve(Curve=ln, Count=count_of_panels, Kinks=False)  # -> Points, Tangents, Parameters
pt = Point(divide_2.Points)
relitem = RelativeItem(Tree=simplify(pt), Offset="{1}", WrapPaths=invert(False), WrapItems=False)  # -> ItemA, ItemB
shift = ShiftList(List=relitem.ItemB, Shift=1, Wrap=invert(True))
shift_2 = ShiftList(List=pt, Shift=1, Wrap=invert(True))
srf4pt = _4PointSurface(CornerA=pt, CornerB=shift_2, CornerC=relitem.ItemB)
srf4pt_2 = _4PointSurface(CornerA=relitem.ItemB, CornerB=shift, CornerC=shift_2)
merge_4 = Merge(Data1=srf4pt, Data2=srf4pt_2)  # -> simplify(Result)
clean = CleanTree(RemoveNulls=True, RemoveInvalid=True, RemoveEmpty=False, Tree=merge_4)

crv = Curve(clean)
offset = OffsetCurve(Curve=crv, Distance=Slider(-10, range=-10..-5), Corners=1)

# ----
# Triangle Panel
srf = Surface(offset)
area = Area(Geometry=srf)  # -> Area, Centroid
pl_origin = PlaneOrigin(Base=srf, Origin=area.Centroid)
item = ListItem(List=flatten(pl_origin), Index=0, Wrap=True)
panel_thickness = Slider(5, range=0..10)
flippln = FlipPlane(Plane=pl_origin, Guide=item, FlipX=False, FlipY=False, FlipZ=True)  # -> Flipped, R
amp = Amplitude(Vector=flippln.Flipped, Amplitude=Slider(-10, range=-10..-9))
amp_2 = Amplitude(Vector=flippln.Flipped, Amplitude=panel_thickness)
move_2 = Move(Geometry=srf, Motion=amp)  # -> Geometry, Transform
extr = Extrude(Base=simplify(move_2.Geometry), Direction=amp_2)

# ----
# PanelFrame
boundary = BoundarySurfaces(Edges=flatten([crv, offset]))
mesh = MeshBrep(
    Brep=boundary,
    Settings={GridMaxCount=0, GridMinCount=16, JaggedSeams=False, MaxEdgeLength=0, MinEdgeLength=0.0001, MinTolerance=0, Refine=True, RefineAngle=0, RelativeTolerance=0.65, SimplePlanes=True, Tolerance=0})
clean_2 = CombineClean(Meshes=mesh)
wbthicken = WeaverbirdsMeshThicken(MeshCurves=clean_2, Distance=Slider(-20, range=-100..-20), OffsetType=0)

panel = Brep(extr)

# ----
# Panel ID
panel_2 = Panel("{;}")
tstat = TreeStatistics(Tree=panel)  # -> Paths, Length, Count
split = TextSplit(Text=tstat.Paths, Separators=panel_2)
item_2 = ListItem(List=split, Index=0, Wrap=True)  # -> Item, Item1, Item2
concat = Concatenate(FragmentA="P", FragmentB=item_2.Item1, FragmentC="-", FragmentD=item_2.Item2)  # -> simplify(Result)
pt_2 = Point(area.Centroid)
unflatten = UnflattenTree(Tree=concat, Guide=pt_2)
tag = TextTag(Location=pt_2, Text=unflatten, Colour=ColourSwatch(SwatchColor=RGB(255, 255, 255)))

# ----
# Panel Area
# Panel Vertex Coordinates
debrep = DeconstructBrep(Brep=panel)  # -> Faces, Edges, Vertices
area_2 = Area(Geometry=debrep.Faces)  # -> Area, Centroid
sort = SortList(Keys=area_2.Area, ValuesA=debrep.Faces)  # -> reverse(Keys), reverse(ValuesA)
item_3 = ListItem(List=sort.ValuesA, Index=0, Wrap=True)
srf_2 = Surface(item_3)
disc = Discontinuity(Curve=srf_2, Level=1)  # -> simplify(Points), Parameters
area_3 = Area(Geometry=srf_2)  # -> simplify(Area), Centroid
item_4 = ListItem(List=disc.Points, Index=0, Wrap=True)  # -> Item, Item1, Item2

# ----
# Panel Bake with Attributes
merge_5 = Merge(Data1=unflatten, Data2=area_3.Area, Data3=item_4.Item, Data4=item_4.Item1, Data5=item_4.Item2)
layer = DefineLayer(Name="panel")
merge_6 = Merge(Data1="panelName", Data2="area", Data3="P1", Data4="P2", Data5="P3")
attributes = DefineObjectAttributes(UserKeys=merge_6, UserValues=merge_5, Layer=layer)
bake = BakeObjects(Geometry=srf_2, Attributes=attributes, BakeName="panelBake", Bake=Button(), groupObject=True)
