# Grasshopper definition part2.gh (Grasshopper 1.0.7)
# plug-ins: Bifocals, EleFront, LunchBox, Pufferfish

# ----
# Sort By Panel ID
panel = Panel("panel")
reflay = ReferenceByLayer(LayerName=panel)
brep = Brep(reflay)
getuv = GetUserValue(Geometry=brep, Key="panelName")
split = TextSplit(Text=getuv, Separators="P-")
item = ListItem(List=split, Index=Slider(1, range=0..1), Wrap=True)  # -> Item, Item1
int = Integer(item.Item)
sort_val = SortDuplicateValues(ValueList=flatten(item.Item))  # -> UniqueValues, Indices
brep_2 = Brep(brep)
sort = SortList(Keys=sort_val.UniqueValues, ValuesA=sort_val.UniqueValues)  # -> Keys, ValuesA
int_2 = Integer(sort.Keys)
mindex = MemberIndex(Set=flatten(int), Member=int_2)  # -> reverse(Index), Count
item_2 = ListItem(List=brep_2, Index=mindex.Index, Wrap=True)

# ----
# Get User attributes
panel_2 = Panel("area")
panel_3 = Panel("""P1
P2
P3""")
brep_3 = Brep(item_2)
getuv_2 = GetUserValue(Geometry=brep_3, Key=panel_3)
getuv_3 = GetUserValue(Geometry=brep_3, Key=panel_2)
brep_4 = Brep(brep_3)
item_3 = ListItem(List=getuv, Index=mindex.Index, Wrap=True)

panel_4 = Panel(item_3)
srf = Surface(brep_4)

# ----
# Panel Draw Position
lng = ListLength(List=item_3)
item_4 = ListItem(List=flatten(lng), Index=0, Wrap=True)
pt = ConstructPoint(XCoordinate=Slider(4000, range=0..10000), YCoordinate=0, ZCoordinate=0)
division = Division(A=item_4, B=2)
number_slider = Slider(10, range=0..100)
num = Number(division)
xy = XYPlane(Origin=pt)
rectangle = Rectangle(Plane=PlaneXY(0, 0, 0), XSize=Slider(1000, range=0..1000), YSize=Slider(1000, range=0..1000), Radius=0)  # -> Rectangle, Length
arrrec = RectangularArray(Geometry=xy, Cell=rectangle.Rectangle, XCount=num, YCount=number_slider)  # -> Geometry, Transform
multiplication = Multiplication(A=num, B=Slider(2, range=0..10))
partition = PartitionList(List=arrrec.Geometry, Size=multiplication)
num_of_panel = ListLength(List=flatten(srf))
multiplication_2 = Multiplication(A=num, B=number_slider)
tstat = TreeStatistics(Tree=partition)  # -> Paths, Length, Count
division_2 = Division(A=num_of_panel, B=multiplication_2)
lng_2 = ListLength(List=tstat.Paths)
series = Series(Start=0, Step=Slider(1000, range=0..1000), Count=lng_2)
Y = UnitY(Factor=series)
move = Move(Geometry=partition, Motion=graft(Y))  # -> flatten(Geometry), Transform
X = UnitX(Factor=Slider(8000, range=0..10000))
arrlinear = LinearArray(Geometry=move.Geometry, Direction=X, Count=division_2)  # -> Geometry, Transform
flip = FlipMatrix(Data=arrlinear.Geometry)

# ----
# Make 2D Panel
srf_2 = Surface(srf)
area = Area(Geometry=srf_2)  # -> Area, Centroid
pl_origin = PlaneOrigin(Base=srf_2, Origin=area.Centroid)
unflatten = UnflattenTree(Tree=flip, Guide=pl_origin)
orient = Orient(Geometry=srf_2, Source=pl_origin, Target=unflatten)  # -> Geometry, Transform

area_attributes = Data(getuv_3)

# ----
# Dimension
srf_3 = Surface(orient.Geometry)
disc = Discontinuity(Curve=srf_3, Level=1)  # -> Points, Parameters
number_slider_2 = Slider(72, range=0..100)
pt_2 = Point(disc.Points)
neg = Negative(Value=number_slider_2)
item_5 = ListItem(List=pt_2, Index=0, Wrap=True)  # -> Item, Item1, Item2
value_list = ValueList({"デフォルト", "テンプレート ミリメートル(建築)"}, selected="テンプレート ミリメートル(建築)")
lineardim = DefineLinearDimension(Point1=item_5.Item, Point2=item_5.Item1, Offset=neg, DimensionStyle=value_list)
lineardim_2 = DefineLinearDimension(Point1=item_5.Item, Point2=item_5.Item2, Offset=number_slider_2, DimensionStyle=value_list)
lineardim_3 = DefineLinearDimension(Point1=item_5.Item1, Point2=item_5.Item2, Offset=neg, DimensionStyle=value_list)
merge = Merge(Data1=lineardim, Data2=lineardim_2, Data3=lineardim_3)

# ----
# drawing frame
num_2 = Number(multiplication)
partition_2 = PartitionList(List=flatten(srf_3), Size=num_2)
number_slider_3 = Slider(3500, range=0..10000)
number_slider_4 = Slider(1400, range=0..10000)
brec = BoundingRectangle(Geometry=partition_2, Plane=PlaneXY(0, 0, 0), Axis=0, Slide=0, Union=True)  # -> Bounding, DimensionX, DimensionY
neg_2 = Negative(Value=number_slider_3)
area_2 = Area(Geometry=brec.Bounding)  # -> Area, Centroid
neg_3 = Negative(Value=number_slider_4)
dom = ConstructDomain(DomainStart=neg_2, DomainEnd=number_slider_3)
dom_2 = ConstructDomain(DomainStart=neg_3, DomainEnd=number_slider_4)
rectangle_2 = Rectangle(Plane=area_2.Centroid, XSize=dom, YSize=dom_2, Radius=0)  # -> Rectangle, Length

panel_id = Data(item_3)

# ----
# Draw Attributes
number_slider_5 = Slider(-313, range=-1000..-200)
area_attributes_2 = Number(area_attributes)
Y_2 = UnitY(Factor=number_slider_5)
Y_3 = UnitY(Factor=Slider(-250, range=-1000..-200))
expression = Expression(x=area_attributes_2, y=Slider(1, range=0..10), Expression="Round(x,y)")
move_2 = Move(Geometry=unflatten, Motion=Y_2)  # -> Geometry, Transform
move_3 = Move(Geometry=unflatten, Motion=Y_3)  # -> Geometry, Transform
concat = Concatenate(FragmentA=expression, FragmentB=" mm2")
panel_id_2 = Data(panel_id)
text = DefineTextObject(Text=concat, Plane=move_2.Geometry, DimensionStyle=value_list, OutputType="Text")
text_2 = DefineTextObject(Text=panel_id_2, Plane=move_3.Geometry, DimensionStyle=value_list, OutputType="Text")

# ----
# Merge Per Paper
data = Data(flatten(text))
srf_4 = Surface(flatten(srf_3))
data_2 = Data(flatten(merge))
data_3 = Data(flatten(text_2))
crv = Curve(rectangle_2.Rectangle)
num_3 = Number(num_2)
multiplication_3 = Multiplication(A=num_3, B=Slider(3, range=0..10))
partition_3 = PartitionList(List=srf_4, Size=num_3)
partition_4 = PartitionList(List=data_2, Size=multiplication_3)
partition_5 = PartitionList(List=data, Size=num_3)
partition_6 = PartitionList(List=data_3, Size=num_3)
merge_2 = Merge(
    Data1=simplify(partition_3),
    Data2=simplify(crv),
    Data3=simplify(partition_4),
    Data4=simplify(partition_5),
    Data5=simplify(partition_6))

# ----
# Bake attribute(ID)
panel_5 = Panel("Panel_ID")
layer = DefineLayer(Name=panel_5)
attributes = DefineObjectAttributes(Layer=layer)
bake = BakeObjects(Geometry=text_2, Attributes=attributes, BakeName="ID", Bake=Button())

# ----
# Bake attribute(Area)
panel_6 = Panel("Panel_Area")
layer_2 = DefineLayer(Name=panel_6)
attributes_2 = DefineObjectAttributes(Layer=layer_2)
bake_2 = BakeObjects(Geometry=text, Attributes=attributes_2, BakeName="area", Bake=Button())

# ----
# Bake attribute(Panel)
panel_7 = Panel("draw_panel")
layer_3 = DefineLayer(Name=panel_7)
attributes_3 = DefineObjectAttributes(Layer=layer_3)
bake_3 = BakeObjects(Geometry=srf_3, Attributes=attributes_3, BakeName="draw_panel", Bake=Button())

# ----
# Bake (Frame)
panel_8 = Panel("Drawing_Frame")
layer_4 = DefineLayer(Name=panel_8)
attributes_4 = DefineObjectAttributes(Layer=layer_4)
bake_4 = BakeObjects(Geometry=rectangle_2.Rectangle, Attributes=attributes_4, BakeName="drawing_frame", Bake=Button())

# ----
# Bake attribute(Dimension)
panel_9 = Panel("dimension")
layer_5 = DefineLayer(Name=panel_9)
attributes_5 = DefineObjectAttributes(Layer=layer_5)
bake_5 = BakeObjects(Geometry=merge, Attributes=attributes_5, BakeName="dimension", Bake=Button())
